% Simulink data dictionary ap_initialModel.sldd

Sig = Simulink.Signal()
LDW_Activity_Flag = 1
LDW_Freq_Hz = 50
LDW_LaneGap_Warning = [0.5 0.25]
LDW_LaneGap_dydt_Warning = 50
LDW_Min_Speed = 60
LDW_Steer_Vibration_Amplitude = 5
LDW_Steer_Vibration_Freq = 25
LKA_Activity_Flag = 1
LKA_D = [0.2 0.3]
LKA_Dyn_Rate_Limiter_Gain = 0.1
LKA_Dyn_Rate_Limiter_Power = 10
LKA_Error_Max = 3
LKA_Error_Off = 0.5
LKA_Error_dydt_Off = 1
LKA_Freq_Hz = 50
LKA_I = [0.025 0.05]
LKA_Lane_Gap_Activate = [0.25 0.125]
LKA_Lane_Gap_dydt_Activate = 50
LKA_Min_Speed = 60
LKA_On_Display_Freq = 5
LKA_P = [0.1 0.2]
LKA_Steer_Rate_Max_radps = 1
d = [3.86 3.58 3.58 3.49 3.48]
d1 = [0.06 0.14 0.24 0.38 0.54]
d2 = [0.7 0.9 0.8 0.75 0.6]
v_lat = [0.2 0.3 0.4 0.5 0.6]
Sig1 = Simulink.Signal()
Wn_lka_out = 0.1
butter_a_lka_out = [1 -1.561018 0.6413515]
butter_b_lka_out = [0.02008337 0.04016673 0.02008337]
ACC_SensorMaxDistance = 250
ACC_MaxThrottle = 130
AEB_Max_Speed = 150
target_speed = 120
ACC_Adaptive_D = 0
ACC_Adaptive_I = 0
ACC_Adaptive_P = [5 7.5]
ACC_Classic_I = 5
ACC_Classic_P = 15
ACC_MaxBrake = 50
ACC_Module_Activity_Flag = 1
ACC_Ready_Speed = 30
ACC_Speed_Distance_Gain = [0.1 0.15 0.2 0.25]
ACC_Speed_Distance_control = 3
ADAS_Control_Mode = 1
AEB_Alarm_Freq = 5
AEB_Brake_Rate = Inf
AEB_Brake_Release_Rate = 25
AEB_Distance_To_Collision_Brake = 5
AEB_Freq_Hz = 25
AEB_Gain = [1 1]
AEB_Gain_set = 60
AEB_Gain_set_mult = 0.03
AEB_Max_Decel = [8 15]
AEB_Max_Distance = 22
AEB_Min_Distance_at_Stop = 1
AEB_Module_Activity_Flag = 1
AEB_Pedestrian_type = 68
AEB_Steer_Max = 180
AP_Activity_Flag = 1
AP_D = [0.3 0.3]
AP_Dyn_Rate_Limiter_Gain = 0.1
AP_Dyn_Rate_Limiter_Power = 10
AP_Error_Max = 3
AP_Freq_Hz = 50
AP_I = [0.05 0.05]
AP_Max_Error_dydt_Disable = 0.5
AP_On_Request_Time = 0.01
AP_P = [0.2 0.2]
AP_Steer_Error_Max = 0.7
AP_Steer_Rate_Max_radps = 1
AP_Transition_Rate = 0.5
Lane_Width = 3.7
No_Target_Display_Value = 0
Sensor_Freq_worldsim = 50
Wn = 0.002
butter_a = [1 -1.991114 0.9911536]
butter_b = [9.825917e-06 1.965183e-05 9.825917e-06]
idx = 1

initCond = struct(
  initialLocation=[370.37890625 14.34459 -0.2848926],
  initialVelocity=20,
  initialYaw=-3.141592,
  rdf="C:\\VI-grade\\VI-WorldSim 2023\\cdb\\tracks.cdb\\roads.tbl\\WS_highway_single_lane_on_off_ramp.rdf")

interactive_mode = 1
radar_source = 2
scenario_path = "D:\\Data\\UPL\\Pete\\WorldSim\\Simulink\\scenarios\\Custom\\highway_on_off_ramp_adas_sensors_ap.json"
simulation_crt = "../VI-CarRealTime_model/SedanCar_WorldSim_Offline_send_svm.xml"
stop_number_collisions = 10
stop_speed = 0.001
stop_time = 12
vehicle_length = 4.7
vehicle_width = 2.2

worldsim_settings = struct(
  endpoint_ip="127.0.0.1",
  endpoint_port=8080,
  car_name="ego",
  verbose=0,
  enable_visual=1,
  res_y=600,
  res_x=800)