% Simulink data dictionary lss_ini_param.sldd

ADAS_Control_Mode = 1
LDW_Activity_Flag = 1
LDW_Freq_Hz = 50
LDW_LaneGap_Warning = [0.5 0.25]
LDW_LaneGap_dydt_Warning = 50
LDW_Min_Speed = 60
LDW_Steer_Vibration_Amplitude = 5
LDW_Steer_Vibration_Freq = 25
LKA_Activity_Flag = 1
LKA_D = [0.2 0.3]
LKA_Dyn_Rate_Limiter_Gain = 0.1
LKA_Dyn_Rate_Limiter_Power = 10
LKA_Error_Max = 3
LKA_Error_Off = 0.5
LKA_Error_dydt_Off = 1
LKA_Freq_Hz = 50
LKA_I = [0.025 0.05]
LKA_Lane_Gap_Activate = [-0.05 0.125]
LKA_Lane_Gap_dydt_Activate = 50
LKA_Min_Speed = 50
LKA_On_Display_Freq = 5
LKA_P = [0.1 0.2]
LKA_Steer_Rate_Max_radps = 1
Sensor_Freq_worldsim = 50
butter_a = [1 -1.991114 0.9911536]
butter_a_lka_out = [1 -1.561018 0.6413515]
butter_b = [9.825917e-06 1.965183e-05 9.825917e-06]
butter_b_lka_out = [0.02008337 0.04016673 0.02008337]
index_variant_approaching_speed = 3
radar_source = 2
variant_approaching_speed = [0.2 0.3 0.4 0.5 0.6]
vehicle_width = 2.05
AP_Transition_Rate = 0.8